# Dynamo graph AI constructor test - load.dyn (Dynamo 1.3.0.875)

file_path = Filename(".\AI constructor test.json")
loadModel = AI.Machine.RegressionMachine.LoadModel(file_path)
name = AI.Machine.Machine.Name(loadModel)
GUID = AI.Machine.Machine.GUID(loadModel)
watch = Watch(GUID)
algorithm = AI.Machine.Machine.Algorithm(loadModel)
watch_2 = Watch(algorithm)
trained = AI.Machine.Machine.Trained(loadModel)
description = AI.Machine.Machine.Description(loadModel)
