# Dynamo graph AI constructor test - save.dyn (Dynamo 1.3.0.875)

simpleLinearRegression = AI.MachineLearning.Regression.SimpleLinearRegression()
code_block = CodeBlock { "TestMachine #1"; "simple machine"; }
regressionMachine = AI.Machine.RegressionMachine.RegressionMachine(simpleLinearRegression, code_block.out0, code_block.out1)
file_path = Filename(".\AI constructor test.json")
saveModel = AI.Machine.RegressionMachine.SaveModel(regressionMachine, file_path)
name = AI.Machine.RegressionMachine.Name(regressionMachine)
GUID = AI.Machine.RegressionMachine.GUID(regressionMachine)
